# Grasshopper definition intro_after.gh (Grasshopper 1.0.7)
# plug-ins: Monoceros

pt = ConstructPoint(XCoordinate=0, YCoordinate=2, ZCoordinate=0)
pt_2 = ConstructPoint(XCoordinate=0, YCoordinate=0, ZCoordinate=0)
sph = Sphere(Base=pt, Radius=Slider(0.5, range=0..1))

number_slider = Slider(1, range=0..10)
number_slider_2 = Slider(4, range=0..10)

constmodule = ConstructModule(ModuleName="module0", ModulePartPoints=pt, Geometry=sph, BasePlane=PlaneXY(0, 0, 0), ModulePartDiagonal=Vector(1, 1, 1))
moduleempty = ConstructEmptyModule(BasePlane=pt_2, ModulePartDiagonal=Vector(1, 1, 1))  # -> Module, Rules
merge = Merge(Data1=constmodule, Data2=moduleempty.Module)

ruleexp = ConstructExplicitRule(
    SourceModuleName="empty",
    SourceConnectorIndex=number_slider_2,
    TargetModuleName="empty",
    TargetConnectorIndex=number_slider)
ruleexp_2 = ConstructExplicitRule(
    SourceModuleName="module0",
    SourceConnectorIndex=number_slider_2,
    TargetModuleName="module0",
    TargetConnectorIndex=number_slider)
ruleexp_3 = ConstructExplicitRule(
    SourceModuleName="module0",
    SourceConnectorIndex=number_slider_2,
    TargetModuleName="empty",
    TargetConnectorIndex=number_slider)
rulebound = ConstructRuleAtBoundary(Module=moduleempty.Module, ConnectorIndex=number_slider_2)
rulebound_2 = ConstructRuleAtBoundary(Module=constmodule, ConnectorIndex=number_slider)

ruleindiffunused = IndifferentRulesForUnusedConnectors(Module=merge, Rules=ruleexp_3)
merge_2 = Merge(Data1=ruleindiffunused, Data2=ruleexp_3, Data3=ruleexp_2, Data4=ruleexp, Data5=rulebound_2, Data6=rulebound)
flatten = FlattenTree(Tree=merge_2, Path="{0}")

sqgrid = Square(Plane=PlaneXY(0, 0, 0), Size=1, ExtentX=5, ExtentY=5)  # -> Cells, Points
flatten_2 = FlattenTree(Tree=sqgrid.Points, Path="{0}")
X = UnitX(Factor=Slider(2, range=0..10))
move = Move(Geometry=flatten_2, Motion=X)  # -> Geometry, Transform
slotall = ConstructSlotWithAllModulesAllowed(SlotPoint=move.Geometry, BasePlane=PlaneXY(0, 0, 0), GridSlotDiagonal=Vector(1, 1, 1))

panel = Panel(flatten)

wfc = MonocerosWFCSolver(
    Slots=slotall,
    Modules=merge,
    Rules=flatten,
    RandomSeed=Slider(84, range=0..100),
    MaxAttempts=10,
    MaxObservations=2147483647,
    MaxTime=0,
    UseShannonEntropy=False)  # -> Out, Slots, Deterministic, Contradictory, Seed, Attempts, Observations
materialize = MaterializeSlots(Modules=merge, Slots=wfc.Slots)  # -> Geometry, Transform
