# Grasshopper definition structure_after.gh (Grasshopper 1.0.7)
# plug-ins: Monoceros

geo = Geometry([<brep referenced from the Rhino model> x13])
geo_2 = Geometry(<brep referenced from the Rhino model>)
geo_3 = Geometry([<brep referenced from the Rhino model> x2])
geo_4 = Geometry([<brep referenced from the Rhino model> x13])
geo_5 = Geometry(<brep referenced from the Rhino model>)
mesh = Mesh(geo)
mesh_2 = Mesh(geo_3)
mesh_3 = Mesh(geo_2)
mesh_4 = Mesh(geo_5)
mesh_5 = Mesh(geo_4)
vec = VectorXYZ(XComponent="0.5", YComponent="0.25", ZComponent="1")  # -> Vector, Length
cluster = Cluster_2(list=mesh_2)  # -> first, last, rest
cluster_2 = Cluster_2(list=mesh)  # -> first, last, rest
swatch = ColourSwatch(SwatchColor=RGB(255, 77, 77))
swatch_2 = ColourSwatch(SwatchColor=RGB(255, 190, 77))
swatch_3 = ColourSwatch(SwatchColor=RGB(103, 159, 219))
cluster_3 = Cluster_2(list=mesh_5)  # -> first, last, rest
cluster_4 = Cluster(color=swatch_2, mesh=mesh_3, light=vec.Vector)  # -> flatten(mesh_2)
cluster_5 = Cluster(color=swatch_2, mesh=cluster.last, light=vec.Vector)  # -> flatten(mesh_2)
cluster_6 = Cluster(color=swatch, mesh=cluster.first, light=vec.Vector)  # -> flatten(mesh_2)
cluster_7 = Cluster(color=swatch_3, mesh=cluster_2.first, light=vec.Vector)
cluster_8 = Cluster(color=swatch_2, mesh=cluster_2.last, light=vec.Vector)
cluster_9 = Cluster(color=swatch, mesh=cluster_2.rest, light=vec.Vector)
cluster_10 = Cluster(color=swatch_3, mesh=cluster_3.first, light=vec.Vector)
cluster_11 = Cluster(color=swatch_2, mesh=cluster_3.last, light=vec.Vector)
cluster_12 = Cluster(color=swatch, mesh=cluster_3.rest, light=vec.Vector)
cluster_13 = Cluster(color=swatch_2, mesh=mesh_4, light=vec.Vector)
merge = Merge(Data1=cluster_7, Data2=cluster_8, Data3=cluster_9)  # -> flatten(Result)
merge_2 = Merge(Data1=cluster_5, Data2=cluster_6)  # -> flatten(Result)
merge_3 = Merge(Data1=cluster_10, Data2=cluster_11, Data3=cluster_12)  # -> flatten(Result)
entwine = Entwine(Branch00=cluster_4, Branch01=merge_2, Branch02=merge, Branch03=merge_3, Branch04=cluster_13, FlattenInputs=True)  # -> simplify(Result)
geo_6 = Geometry(entwine)

group = Group(Objects=geo_6)  # -> flatten(Group)
lng = ListLength(List=group)
series = Series(Start=0, Step=1, Count=lng)
concat = Concatenate(FragmentA="module", FragmentB=series)
graft = GraftTree(Tree=concat, IncludeEmptyLists=True, IncludeNullItems=True)

number_slider = Slider(2, range=0..10)
number_slider_2 = Slider(6, range=0..10)
pt = ConstructPoint(XCoordinate=number_slider, YCoordinate=number_slider, ZCoordinate=0)
series_2 = Series(Start=0, Step=1, Count=Slider(5, range=0..10))
sqgrid = Square(Plane=pt, Size=1, ExtentX=number_slider_2, ExtentY=number_slider_2)  # -> Cells, Points
graft_2 = GraftTree(Tree=series_2, IncludeEmptyLists=True, IncludeNullItems=True)
Z = UnitZ(Factor=graft_2)
flatten = FlattenTree(Tree=sqgrid.Points, Path="{0}")
move = Move(Geometry=flatten, Motion=Z)  # -> Geometry, Transform
slotall = ConstructSlotWithAllModulesAllowed(SlotPoint=move.Geometry, BasePlane=PlaneXY(0, 0, 0), GridSlotDiagonal=Vector(1, 1, 1))

number_slider_3 = Slider(2, range=0..10)
series_3 = Series(Start=number_slider_3, Step=number_slider_3, Count=Slider(5, range=0..10))
number_slider_4 = Slider(0.5, range=0..1)
pt_2 = ConstructPoint(XCoordinate=series_3, YCoordinate=0, ZCoordinate=0)
graft_3 = GraftTree(Tree=pt_2, IncludeEmptyLists=True, IncludeNullItems=True)  # -> simplify(Tree)
box = CenterBox(Base=pt_2, X=number_slider_4, Y=number_slider_4, Z=number_slider_4)

debrep = DeconstructBrep(Brep=box)  # -> Faces, Edges, Vertices
area = Area(Geometry=debrep.Faces)  # -> Area, Centroid

moduleempty = ConstructEmptyModule(BasePlane=PlaneXY(0, 0, 0), ModulePartDiagonal=Vector(1, 1, 1))  # -> Module, Rules
constmodule = ConstructModule(
    ModuleName=graft,
    ModulePartPoints=graft_3,
    Geometry=geo_6,
    BasePlane=PlaneXY(0, 0, 0),
    ModulePartDiagonal=Vector(1, 1, 1))
merge_4 = Merge(Data1=moduleempty.Module, Data2=constmodule)
flatten_2 = FlattenTree(Tree=merge_4, Path="{0}")

pt_3 = Point([<point referenced from the Rhino model> x4])
ruletyppt = TypedRuleFromPoint(Modules=flatten_2, PointTag=pt_3, ConnectorType="type-a")
flatten_3 = FlattenTree(Tree=ruletyppt, Path="{0}")
ruleindiffunused = IndifferentRulesForUnusedConnectors(Module=flatten_2, Rules=flatten_3)
merge_5 = Merge(Data1=ruleindiffunused, Data2=flatten_3)

panel = Panel("""4
0
3
1""")
panel_2 = Panel("""1
3
0
4""")
rulebound = ConstructRuleAtBoundary(Module=moduleempty.Module, ConnectorIndex="5")
ruleexp = ConstructExplicitRule(SourceModuleName="empty", SourceConnectorIndex=panel_2, TargetModuleName="module4", TargetConnectorIndex=panel)

panel_3 = Panel("""4
0
3
1""")
panel_4 = Panel("""1
3
0
4""")
panel_5 = Panel("""1
3""")
panel_6 = Panel("""4
0""")
panel_7 = Panel("""1
3""")
panel_8 = Panel("""4
0""")
ruleexp_2 = ConstructExplicitRule(SourceModuleName="module3", SourceConnectorIndex=panel_4, TargetModuleName="module2", TargetConnectorIndex=panel_3)
ruleexp_3 = ConstructExplicitRule(SourceModuleName="module3", SourceConnectorIndex=panel_5, TargetModuleName="module3", TargetConnectorIndex=panel_6)
ruleexp_4 = ConstructExplicitRule(SourceModuleName="module2", SourceConnectorIndex=panel_7, TargetModuleName="module2", TargetConnectorIndex=panel_8)
merge_6 = Merge(Data1=ruleexp_4, Data2=ruleexp_3, Data3=ruleexp_2, Data4=ruleexp, Data5=rulebound)
flatten_4 = FlattenTree(Tree=merge_6, Path="{0}")

flatten_5 = FlattenTree(Tree=merge_5, Path="{0}")
collectrules = CollectRules(Modules=flatten_2, RulesAllowed=flatten_5, ExplicitRulesDisallowed=flatten_4)

flatten_6 = FlattenTree(Tree=flatten_2, Path="{0}")
flatten_7 = FlattenTree(Tree=collectrules, Path="{0}")
flatten_8 = FlattenTree(Tree=slotall, Path="{0}")
wfc = MonocerosWFCSolver(
    Slots=flatten_8,
    Modules=flatten_6,
    Rules=flatten_7,
    RandomSeed=Slider(511, range=0..1000),
    MaxAttempts=10,
    MaxObservations=2147483647,
    MaxTime=0,
    UseShannonEntropy=False)  # -> Out, Slots, Deterministic, Contradictory, Seed, Attempts, Observations
materialize = MaterializeSlots(Modules=flatten_2, Slots=wfc.Slots)  # -> Geometry, Transform

geo_7 = Geometry(materialize.Geometry)

# ==== cluster Cluster
color = ClusterInput()
mesh = ClusterInput()
light = ClusterInput()
demesh = DeconstructMesh(Mesh=mesh)  # -> Vertices, Faces, Colours, Normals
unit = UnitVector(Vector=light)
dprod = DotProduct(VectorA=demesh.Normals, VectorB=unit, Unitize=False)
remap = RemapNumbers(Value=dprod, Source=Domain(-1, 1), Target=Domain(0, 1))  # -> Mapped, Clipped
graft = GraftTree(Tree=mesh, IncludeEmptyLists=True, IncludeNullItems=True)
multiplication = Multiplication(A=color, B=remap.Mapped)
mcol = MeshColours(Mesh=graft, Colours=multiplication)
mesh_2 = ClusterOutput(mcol)

# ==== cluster Cluster_2
list = ClusterInput()
lng = ListLength(List=list)
subtraction = Subtraction(A=lng, B="2")
dom = ConstructDomain(DomainStart="1", DomainEnd=subtraction)
item = ListItem(List=reverse(list), Index=0, Wrap=True)
item_2 = ListItem(List=list, Index=0, Wrap=True)
subset = SubList(List=list, Domain=dom, Wrap=True)  # -> List, Index
first = ClusterOutput(item_2)
last = ClusterOutput(item)
rest = ClusterOutput(subset.List)
